# Grasshopper definition GH-GCODE-GEN.ghx (Grasshopper 1.0.4)
# Generates a centerline-programmed gcode file from input parameters and single or multiple curves.

plungerate_units_minute = Slider(100, range=0..1000)
retractrate_units_minute = Slider(200, range=0..1000)
col = Colour(RGB(239, 157, 89))
col_2 = Colour(RGB(229, 246, 89))
col_3 = Colour(RGB(234, 88, 89))
panel = Panel("""0
1
2""")
pdecon = Deconstruct()  # -> XComponent, YComponent, ZComponent
item = ListItem(List=flatten(pdecon.XComponent), Index=0, Wrap=True)
item_2 = ListItem(List=flatten(pdecon.YComponent), Index=0, Wrap=True)
header = Panel("G0 G17 G90")
footer = Panel("M30")

feedrate_units_minute = Slider(500, range=0..1000)
tolerance_units = Slider(5, range=0..100)
# Grasshopper
# GCode
# Generator
# v3
# 
# Brett Ian Balogh
# Spring 2018
# Embodying Code
# ARTTECH 3016
units = ValueList({"INCH": "G20", "MM": "G21"}, selected="MM")
geometry = Curve([<curve referenced from the Rhino model> x2])
cut_depth = Slider(-0.5, range=-1..0)
retract_height = Slider(2.6, range=0..1000)

c_script = CSharpScript(G=geometry)  # -> out, L, C; inputs G: list of Curve
# ---------- c_script: C# ----------
List<Rhino.Geometry.Curve> curves = new List<Rhino.Geometry.Curve>();
List<Rhino.Geometry.Curve> lines = new List<Rhino.Geometry.Curve>();

foreach (Rhino.Geometry.Curve input in G){
if(input.Degree > 1){
	curves.Add(input);
}
else{
lines.Add(input);
}
}
L = lines;
C = curves;
# ---------- end c_script ----------
divlength = DivideLength(Curve=c_script.C, Length=tolerance_units)  # -> Points, Tangents, Parameters
end = EndPoints(Curve=c_script.C)  # -> Start, End
lng = ListLength(List=flatten(divlength.Points))
ins = InsertItems(List=divlength.Points, Item=end.End, Indices=lng, Wrap=False)
pline = PolyLine(Vertices=ins, Closed=False)
entwine = Entwine(Branch00=c_script.L, Branch01=pline, FlattenInputs=True)
points = PointList(Points=ins, Size=Slider(1, range=0..1))
Z = UnitZ(Factor=cut_depth)
panel_2 = Panel(entwine)
move = Move(Geometry=entwine, Motion=Z)  # -> Geometry, Transform

end_2 = EndPoints(Curve=move.Geometry)  # -> flatten(Start), flatten(End)
shift = ShiftList(List=end_2.End, Shift=1, Wrap=True)
pdecon_2 = Deconstruct(Point=shift)  # -> XComponent, YComponent, ZComponent
pdecon_3 = Deconstruct(Point=end_2.Start)  # -> XComponent, YComponent, ZComponent
pt = ConstructPoint(XCoordinate=pdecon_3.XComponent, YCoordinate=pdecon_3.YComponent, ZCoordinate=retract_height)
pt_2 = ConstructPoint(XCoordinate=pdecon_2.XComponent, YCoordinate=pdecon_2.YComponent, ZCoordinate=retract_height)
ln = Line(StartPoint=pt, EndPoint=pt_2)
ln_2 = Line(StartPoint=shift, EndPoint=pt_2)
ln_3 = Line(StartPoint=end_2.Start, EndPoint=pt)

col_4 = Colour(RGB(235, 239, 89))
col_5 = Colour(RGB(65, 218, 255))
col_6 = Colour(RGB(244, 17, 0))
col_7 = Colour(RGB(245, 67, 255))
col_8 = Colour(RGB(90, 107, 255))
preview = CustomPreview(Geometry=move.Geometry, Shader=col_5)
preview_2 = CustomPreview(Geometry=ln_3, Shader=col_7)
preview_3 = CustomPreview(Geometry=ln, Shader=col_4)
preview_4 = CustomPreview(Geometry=ln_2, Shader=col_6)
preview_5 = CustomPreview(Geometry=entwine, Shader=col_8)

preview_6 = CustomPreview(Geometry=move.Geometry, Shader=col)
end_3 = EndPoints(Curve=move.Geometry)  # -> Start, End
Z_2 = UnitZ(Factor=retract_height)
Z_3 = UnitZ(Factor=retract_height)
move_2 = Move(Geometry=end_3.Start, Motion=Z_2)  # -> Geometry, Transform
vec2pt = Vector2Pt(PointA=move_2.Geometry, PointB=end_3.Start, Unitize=False)  # -> Vector, Length
move_3 = Move(Geometry=end_3.End, Motion=Z_3)  # -> Geometry, Transform
vec2pt_2 = Vector2Pt(PointA=end_3.End, PointB=move_3.Geometry, Unitize=False)  # -> Vector, Length
vdisex = VectorDisplayEx(Point=move_2.Geometry, Vector=vec2pt.Vector, Colour=col_2, Width=2)
ln_4 = Line(StartPoint=move_2.Geometry, EndPoint=end_3.Start)
ln_5 = Line(StartPoint=end_3.End, EndPoint=move_3.Geometry)
weave = Weave(Pattern=panel, Stream0=ln_4, Stream1=move.Geometry, Stream2=ln_5, NullGaps=False)
vdisex_2 = VectorDisplayEx(Point=end_3.End, Vector=vec2pt_2.Vector, Colour=col_3, Width=2)
panel_3 = Panel(weave)
item_3 = ListItem(List=weave, Index=0, Wrap=True)
item_4 = ListItem(List=weave, Index=1, Wrap=True)
item_5 = ListItem(List=weave, Index=2, Wrap=True)
end_4 = EndPoints(Curve=item_3)  # -> Start, End
cp = ControlPoints(Curve=item_4)  # -> Points, Weights, Knots
end_5 = EndPoints(Curve=item_5)  # -> Start, End
code = Expression(
    X=pdecon.XComponent,
    Y=pdecon.YComponent,
    Z=pdecon.ZComponent,
    F=feedrate_units_minute,
    Expression="Format(\"G1 X{0:0.000} Y{1:0.000} Z{2:0.000} F{3:0.0}\", X, Y, Z, F)")
pdecon_4 = Deconstruct(Point=end_4.Start)  # -> XComponent, YComponent, ZComponent
pdecon_5 = Deconstruct(Point=end_4.End)  # -> XComponent, YComponent, ZComponent
pdecon_6 = Deconstruct(Point=cp.Points)  # -> XComponent, YComponent, ZComponent
code_2 = Expression(X=item, Y=item_2, Z=retract_height, Expression="Format(\"G0 X{0:0.000} Y{1:0.000} Z{2:0.000}\", X, Y, Z)")
pdecon_7 = Deconstruct(Point=end_5.Start)  # -> XComponent, YComponent, ZComponent
pdecon_8 = Deconstruct(Point=end_5.End)  # -> XComponent, YComponent, ZComponent
code_3 = Expression(
    X=pdecon_5.XComponent,
    Y=pdecon_5.YComponent,
    Z=pdecon_5.ZComponent,
    F=plungerate_units_minute,
    Expression="Format(\"1 G1 X{0:0.000} Y{1:0.000} Z{2:0.000} F{3:0.0}\", X, Y, Z, F)")  # -> flatten(R)
code_4 = Expression(
    X=pdecon_4.XComponent,
    Y=pdecon_4.YComponent,
    Z=pdecon_4.ZComponent,
    Expression="Format(\"0 G0 X{0:0.000} Y{1:0.000} Z{2:0.000} \", X, Y, Z)")  # -> flatten(R)
code_5 = Expression(
    X=pdecon_6.XComponent,
    Y=pdecon_6.YComponent,
    Z=pdecon_6.ZComponent,
    F=feedrate_units_minute,
    Expression="Format(\"2 G1 X{0:0.000} Y{1:0.000} Z{2:0.000} F{3:0.0}\", X, Y, Z, F)")  # -> flatten(R)
code_6 = Expression(
    X=pdecon_8.XComponent,
    Y=pdecon_8.YComponent,
    Z=pdecon_8.ZComponent,
    F=retractrate_units_minute,
    Expression="Format(\"3 G1 X{0:0.000} Y{1:0.000} Z{2:0.000} F{3:0.0}\", X, Y, Z, F)")  # -> flatten(R)
move_to_origin_at_retract_height = Panel(code_2)
entwine_2 = Entwine(
    Branch00=header,
    Branch01=units,
    Branch02=move_to_origin_at_retract_height,
    Branch03=code,
    Branch04=footer,
    FlattenInputs=True)

gcode_output = Panel(entwine_2)

weave_2 = Weave(Pattern=[0, 1, 2, 3], Stream0=code_4, Stream1=code_3, Stream2=code_5, Stream3=code_6, NullGaps=False)
panel_4 = Panel(weave_2)
